# Grasshopper definition gradio_test.gh (Grasshopper 1.0.8)

# ---- group: reference python file
path = FilePath("C:\Users\scleb\Documents\bimsc25\GitHub\aia25-studio-agent-group4\gradio_gui.py")

# ----
button = Button()
file = ReadFile(File=path, PerLineParse=False)
py3 = Python3Script(script=file, run=Toggle(True))  # -> out, a, b; unedited script template
panel = Panel(file)
panel_2 = Panel(py3.out)
